# Grasshopper definition VisualiseSocialDistancing.gh (Grasshopper 1.0.7)
# plug-ins: SocialDistancingForSidewalks, EleFront, Human, Urbano, LunchBox

# ----
# To download shp file, go to
# https://data.cityofnewyork.us/City-Government/Sidewalk/vfx9-tbb6#About
#  and export shape file. Save file to Data source file in the current directory
data_source_name = Panel("\geo_export_ae114f87-9731-4e1c-bb49-080b2621f032.shp")
# SIDEWALK DATA EXTRACTION  - No need to run this, it is just for reference
# LAYER: Sidewak srf is baked from this script
ghpython_script = GhPythonScript()  # -> out, dir
# ---------- ghpython_script: Python ----------
__author__ = "JSzychowska"
__version__ = "2021.11.15"

import rhinoscriptsyntax as rs
import System.IO.Path as Path

file_name = ghenv.Component.OnPingDocument().FilePath

dir = Path.GetDirectoryName(file_name)
# ---------- end ghpython_script ----------
# start here
# inputs
panel = Panel("40.7235")
concatenate = Concatenate(FragmentA=ghpython_script.dir, FragmentB=data_source_name)
import_shapefile_features = ImportShapefileFeatures(
    ShapefilePath=concatenate,
    Reproject=True,
    UTMZone="18",
    LeftBound="-74.0173",
    RightBound="-73.9982",
    TopBound="40.7235",
    BottomBound=panel)  # -> Points, Metadata, UTMZone, TranslationVector; disabled
deconstruct_metadata = DeconstructMetadata(Metadata=import_shapefile_features.Metadata)  # -> Keys, Values; disabled
construct_point = ConstructPoint(XCoordinate=0, YCoordinate=0, ZCoordinate=0)  # disabled
polyline = PolyLine(Vertices=import_shapefile_features.Points, Closed=False)  # disabled
panel_2 = Panel("3")  # disabled
panel_3 = Panel("3.28084")  # disabled
list_item = ListItem(List=deconstruct_metadata.Values, Index=panel_2, Wrap=True)  # disabled
scale = Scale(Geometry=polyline, Center=construct_point, Factor=panel_3)  # -> Geometry, Transform; disabled
sort_duplicate_values = SortDuplicateValues(ValueList=flatten(list_item))  # -> UniqueValues, Indices; disabled
list_length = ListLength(List=sort_duplicate_values.Indices)  # disabled
surface = Surface(scale.Geometry)  # disabled
panel_4 = Panel("2")  # disabled
equality = Equality(FirstNumber=list_length, SecondNumber=panel_4)  # -> Equality, Inequality; disabled
dispatch = Dispatch(List=sort_duplicate_values.Indices, DispatchPattern=equality.Equality)  # -> ListA, ListB; disabled
list_item_2 = ListItem(List=flatten(surface), Index=dispatch.ListB, Wrap=True)  # disabled
list_item_3 = ListItem(List=flatten(surface), Index=dispatch.ListA, Wrap=True)  # disabled
list_length_2 = ListLength(List=list_item_2)  # disabled
panel_5 = Panel("1")  # disabled
clean_tree = CleanTree(RemoveNulls=True, RemoveInvalid=True, RemoveEmpty=True, Tree=list_item_3)  # disabled
equality_2 = Equality(FirstNumber=list_length_2, SecondNumber=panel_5)  # -> Equality, Inequality; disabled
area = Area(Geometry=clean_tree)  # -> Area, Centroid; disabled
dispatch_2 = Dispatch(List=list_item_2, DispatchPattern=equality_2.Equality)  # -> ListA, ListB; disabled
sort_list = SortList(Keys=area.Area, ValuesValuesA=clean_tree)  # -> Keys, ValuesValuesA; disabled
data = Data(dispatch_2.ListB)  # disabled
area_2 = Area(Geometry=dispatch_2.ListA)  # -> Area, Centroid; disabled
number_slider = Slider(30634, range=0..1000000)  # disabled
clean_tree_2 = CleanTree(RemoveNulls=True, RemoveInvalid=True, RemoveEmpty=True, Tree=data)  # disabled
panel_6 = Panel("1")  # disabled
panel_7 = Panel("0")  # disabled
list_item_4 = ListItem(List=sort_list.ValuesValuesA, Index=panel_6, Wrap=True)  # disabled
list_item_5 = ListItem(List=sort_list.ValuesValuesA, Index=0, Wrap=True)  # disabled
list_item_6 = ListItem(List=clean_tree_2, Index=0, Wrap=True)  # disabled
cull_index = CullIndex(List=clean_tree_2, Indices=panel_7, Wrap=True)  # disabled
smaller_than = SmallerThan(FirstNumber=area_2.Area, SecondNumber=number_slider)  # -> SmallerThan, OrEqualTo; disabled
flatten_tree = FlattenTree(Tree=list_item_5, Path="{0}")  # -> graft(Tree); disabled
flatten_tree_2 = FlattenTree(Tree=list_item_4, Path="{0}")  # -> graft(Tree); disabled
solid_intersection = SolidIntersection(BrepsA=list_item_6, BrepsB=cull_index)  # disabled
solid_intersection_2 = SolidIntersection(BrepsA=flatten_tree_2, BrepsB=flatten_tree)  # disabled
dispatch_3 = Dispatch(List=dispatch_2.ListA, DispatchPattern=smaller_than.SmallerThan)  # -> ListA, ListB; disabled
geometry = Geometry(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)  # disabled
end_points = EndPoints(Curve=geometry)  # -> Start, End; disabled
vector_2pt = Vector2Pt(PointA=end_points.Start, PointB=end_points.End, Unitize=False)  # -> Vector, Length; disabled
data_2 = Data(dispatch_3.ListA)  # disabled
data_3 = Data(solid_intersection_2)  # disabled
data_4 = Data(solid_intersection)  # disabled
merge = Merge(Data1=data_2, Data2=data_3)  # -> flatten(Result); disabled
move = Move(Geometry=merge, Motion=vector_2pt.Vector)  # -> Geometry, Transform; disabled
data_5 = Data(move.Geometry)  # disabled

# ----
# info
used_plugins = Panel("""Elefront
Urbano
SocialDistancingForSidewalks""")
versions = Panel("""Rhino 7
Grasshopper 1.0.0007""")
# standard grasshopper calc
# my components
# visualise
instructions = Panel("https://github.com/just-ajs/distancing-on-sidewalks")

# ----
# Walking inputs
walking_speed_miles_hour = Slider(3, range=2..5)
hour_of_the_day = Slider(14, range=0..24)
# Sidewalk inputs
very_bad_width = Slider(5.9, range=1..10)
good_width = Slider(15, range=1..30)

# ----
# Sidewalks geometry
panel_8 = Panel("GH Bake::Sidewalk srf")
reference_by_layer = ReferenceByLayer(LayerName=panel_8)

# ----
# Crowd ''attraction'' geometry
# Get geometry that can cause
# more crowds/standing for example:
# landmarks, bustops,
panel_9 = Panel("Subway Entrances")
max_radius_attraction = Slider(141, range=0..5000)
max_radius_attraction_2 = Slider(84, range=0..100)
merge_with_widths = BooleanToggle(False)
reference_by_layer_2 = ReferenceByLayer(LayerName=panel_9)
merge_with_widths_2 = BooleanToggle(True)
reference_by_layer_3 = ReferenceByLayer(LayerName="Roadbed")

# ----
# INPUTS
# Area for analysis
selected_area_curve = Geometry(<curve referenced from the Rhino model>)

# ----
# Example of finding ''centres''
number_slider_2 = Slider(50, range=50..1000)
length = Length(Curve=reference_by_layer_3)
explode = Explode(Curve=reference_by_layer_2, Recursive=True)  # -> Segments, Vertices
smaller_than_2 = SmallerThan(FirstNumber=length, SecondNumber=Slider(275, range=100..1000))  # -> SmallerThan, OrEqualTo
larger_than = LargerThan(FirstNumber=length, SecondNumber=number_slider_2)  # -> LargerThan, OrEqualTo
gate_and = GateAnd(A=smaller_than_2.SmallerThan, B=larger_than.LargerThan)
cull_pattern = CullPattern(List=reference_by_layer_3, CullPattern=gate_and)
explode_2 = Explode(Curve=cull_pattern, Recursive=True)  # -> Segments, Vertices
average = Average(Input=explode.Vertices)  # -> flatten(ArithmeticMean)
average_2 = Average(Input=explode_2.Vertices)  # -> flatten(ArithmeticMean)

# ----
# Find geometry inside of selected area - possibly could be added as part of component for 'cleaner' workflow
surface_split = SurfaceSplit(Surface=reference_by_layer, Curves=selected_area_curve)
area_3 = Area(Geometry=surface_split)  # -> Area, Centroid
point_in_curve = PointInCurve(Point=area_3.Centroid, Curve=selected_area_curve)  # -> Relationship, Point
equality_3 = Equality(FirstNumber=point_in_curve.Relationship, SecondNumber="2")  # -> Equality, Inequality
cull_pattern_2 = CullPattern(List=surface_split, CullPattern=equality_3.Equality)
sidewalk_geometry = Brep(flatten(cull_pattern_2))

sidewalk_geometry_2 = Brep(sidewalk_geometry)
# my components
walking_speed_miles_hour_2 = Data(walking_speed_miles_hour)
hour_of_the_day_2 = Data(hour_of_the_day)
# finds centrelines and extracts widths
#  based on sample points
surfacecentrelines = SurfaceCentrelines(Surface=sidewalk_geometry_2)  # -> Centrelines, SamplePoints, Width
# this component will calculate how many
#  people will be on the given sidewalk at once
estimatepeopleperminute = EstimatePeoplePerMinute(Surface=sidewalk_geometry, WalkingSpeed=walking_speed_miles_hour_2, Hour=hour_of_the_day_2)
# recalculate weights based on
# the attraction points
recalculateweightscomponent = RecalculateWeightsComponent(
    TestPoints=surfacecentrelines.SamplePoints,
    TestPointsWeights=surfacecentrelines.Width,
    LocationPoints=average,
    DistanceLimit=max_radius_attraction)  # -> RecalculatedWeights, OnlyNewWeights
# recalculate weights based on
# the attraction points
recalculateweightscomponent_2 = RecalculateWeightsComponent(
    TestPoints=surfacecentrelines.SamplePoints,
    TestPointsWeights=surfacecentrelines.Width,
    LocationPoints=average_2,
    DistanceLimit=max_radius_attraction_2)  # -> RecalculatedWeights, OnlyNewWeights
what_is_considered_too_narrow_width = Data(very_bad_width)
width_easy_for_social_distancing = Data(good_width)

# ----
# Srf -> mesh for colouring
mesh = Mesh(sidewalk_geometry_2)
deconstruct_mesh = DeconstructMesh(Mesh=mesh)  # -> Vertices, Faces, Colours, Normals
closest_point = ClosestPoint(Point=deconstruct_mesh.Vertices, Cloud=surfacecentrelines.SamplePoints)  # -> ClosestPoint, CPIndex, Distance

# ----
# Visualise number of people:
# possibly could be used for circle packing etc
# visualise
number_slider_3 = Slider(3.2, range=0..10)
populate_geometry = PopulateGeometry(Geometry=graft(sidewalk_geometry), Count=estimatepeopleperminute, Seed=1)  # disabled
circle = Circle(Plane=populate_geometry, Radius=number_slider_3)

# ----
# Colour mesh based on only attraction points or attractions points merged with the width data
list_item_7 = ListItem(List=recalculateweightscomponent.OnlyNewWeights, Index=closest_point.CPIndex, Wrap=True)
list_item_8 = ListItem(List=recalculateweightscomponent.RecalculatedWeights, Index=closest_point.CPIndex, Wrap=True)
selected_area_curve_2 = Geometry(selected_area_curve)
gradient = Gradient(LowerLimit=0, UpperLimit=1, Parameter=list_item_7, stops=[0.498: RGB(42, 38, 255), 1: RGBA(189, 81, 111, 28)])
gradient_2 = Gradient(
    LowerLimit=what_is_considered_too_narrow_width,
    UpperLimit=width_easy_for_social_distancing,
    Parameter=list_item_8,
    stops=[0: RGB(255, 0, 0), 0.481: RGB(255, 255, 0), 1: RGB(0, 128, 0)])
list_item_9 = ListItem(List=recalculateweightscomponent_2.RecalculatedWeights, Index=closest_point.CPIndex, Wrap=True)
list_item_10 = ListItem(List=recalculateweightscomponent_2.OnlyNewWeights, Index=closest_point.CPIndex, Wrap=True)
gradient_3 = Gradient(
    LowerLimit=what_is_considered_too_narrow_width,
    UpperLimit=width_easy_for_social_distancing,
    Parameter=list_item_9,
    stops=[0: RGB(255, 0, 0), 0.481: RGB(255, 255, 0), 1: RGB(0, 128, 0)])
gradient_4 = Gradient(LowerLimit=0, UpperLimit=1, Parameter=list_item_10, stops=[0.498: RGB(42, 38, 255), 1: RGBA(189, 81, 111, 28)])
stream_filter = StreamFilter(Gate=merge_with_widths, Stream0=gradient, Stream1=gradient_2)
unit_z = UnitZ(Factor=Slider(1000, range=0..2000))
mesh_colours = MeshColours(Mesh=graft(mesh), Colours=stream_filter)
stream_filter_2 = StreamFilter(Gate=merge_with_widths_2, Stream0=gradient_4, Stream1=gradient_3)
unit_z_2 = UnitZ(Factor=Slider(0, range=0..2000))
move_2 = Move(Geometry=selected_area_curve_2, Motion=unit_z_2)  # -> Geometry, Transform
move_3 = Move(Geometry=selected_area_curve_2, Motion=unit_z)  # -> Geometry, Transform
mesh_colours_2 = MeshColours(Mesh=graft(mesh), Colours=stream_filter_2)
point_on_curve = PointOnCurve(move_2.Geometry, parameter=0.732)
concatenate_2 = Concatenate(FragmentA=panel_9, FragmentB=" activity")
point_on_curve_2 = PointOnCurve(move_3.Geometry, parameter=0.732)
move_4 = Move(Geometry=mesh_colours_2, Motion=unit_z_2)  # -> Geometry, Transform
move_5 = Move(Geometry=mesh_colours, Motion=unit_z)  # -> Geometry, Transform
text_tag_3d = TextTag3D(
    Location=point_on_curve,
    Text="Crosswalks activity",
    Size=Slider(37, range=0..100),
    Colour=ColourSwatch(SwatchColor=RGB(0, 0, 19)),
    Justification=7)
text_tag_3d_2 = TextTag3D(
    Location=point_on_curve_2,
    Text=concatenate_2,
    Size=Slider(37, range=0..100),
    Colour=ColourSwatch(SwatchColor=RGB(0, 0, 19)),
    Justification=7)

# ----
# Basic colouring based on width
list_item_11 = ListItem(List=surfacecentrelines.Width, Index=closest_point.CPIndex, Wrap=True)
gradient_5 = Gradient(
    LowerLimit=what_is_considered_too_narrow_width,
    UpperLimit=width_easy_for_social_distancing,
    Parameter=list_item_11,
    stops=[0.00114: RGB(255, 26, 62), 0.5: RGB(255, 235, 50), 0.978: RGB(95, 183, 86)])
mesh_colours_3 = MeshColours(Mesh=graft(mesh), Colours=gradient_5)

# ----
# Visualise number of people that will be on surface at once during selected hour
number_slider_4 = Slider(527, range=0..5000)
vector_xyz = VectorXYZ(XComponent=0, YComponent=0, ZComponent=number_slider_4)  # -> Vector, Length
area_4 = Area(Geometry=sidewalk_geometry_2)  # -> Area, Centroid
move_6 = Move(Geometry=area_4.Centroid, Motion=vector_xyz.Vector)  # -> Geometry, Transform
xz_plane = XZPlane(Origin=move_6.Geometry)
line = Line(StartPoint=area_4.Centroid, EndPoint=move_6.Geometry)
text_tag_3d_3 = TextTag3D(
    Location=xz_plane,
    Text=flatten(estimatepeopleperminute),
    Size=Slider(25, range=0..500),
    Colour=ColourSwatch(SwatchColor=RGB(37, 25, 64)),
    Justification=7)
concatenate_3 = Concatenate(FragmentA="Average number of people at once during hour: ", FragmentB=hour_of_the_day)

move_7 = Move(Geometry=selected_area_curve_2, Motion=vector_xyz.Vector)  # -> Geometry, Transform

custom_preview_lineweights = CustomPreviewLineweights(
    Geometry=[line, move_2.Geometry, move_3.Geometry, move_7.Geometry],
    Shader=ColourSwatch(SwatchColor=RGBA(186, 186, 186, 60)),
    Absolute=False)
point_on_curve_3 = PointOnCurve(move_7.Geometry, parameter=0.732)
text_tag_3d_4 = TextTag3D(
    Location=point_on_curve_3,
    Text=concatenate_3,
    Size=Slider(30, range=0..100),
    Colour=ColourSwatch(SwatchColor=RGB(0, 0, 19)),
    Justification=7)
